# Grasshopper definition fireflyinterface.gh (Grasshopper 0.9.56)
# plug-ins: Firefly

timer = Timer(TimerInterval=20, Target=uno_read)
ports_available = COMPortsAvailable()
panel = Panel(ports_available)
uno_read = UnoRead(StartReadingValues=Toggle(True), PortNumber=panel)  # -> AnalogPin0, AnalogPin1, AnalogPin2, AnalogPin3, AnalogPin4, AnalogPin5, DigitalPin2, DigitalPin4, DigitalPin7, StatusMessage
panel_2 = Panel(uno_read.AnalogPin0)
num = Number(flatten(200))
hexgrid = Hexagonal(Plane=PlaneXY(0, 0, 0), Size=1, ExtentX=5, ExtentY=5)  # -> Cells, Points
open_port = OpenClosePort(OpenClosePort=Toggle(True), PortNumber=panel, BaudRate=115200)
division = Division(A=panel_2, B=num)
panel_3 = Panel(division)
cir = Circle(Plane=hexgrid.Points, Radius=division)
panel_4 = Panel(open_port)
boundary = BoundarySurfaces(Edges=[hexgrid.Cells, cir])
